# Grasshopper definition BranchNodeRnd.gh (Grasshopper 1.0.7)
# Spherical spikey thing

branch_length = Slider(10, range=0..10)
cell_radius = Slider(10, range=0..10)
radius = GetNumber(cell_radius, AtLeast=1, AtMost=2147483647, Maximum=1.797693135e+308, Minimum=-1.797693135e+308, TreeAccess=False)
count = GetNumber(
    Slider(17, range=1..100),
    AtLeast=1,
    AtMost=2147483647,
    Maximum=1.797693135e+308,
    Minimum=-1.797693135e+308,
    TreeAccess=False)
length = GetNumber(branch_length, AtLeast=1, AtMost=2147483647, Maximum=1.797693135e+308, Minimum=-1.797693135e+308, TreeAccess=False)
panel = Panel(length)
xy = XYPlane(Origin=Point(0, 0, 0))
rectangle = Rectangle(Plane=xy, XSize=radius, YSize=count, Radius=0)  # -> Rectangle, Length
srf = Surface(rectangle.Rectangle)
Z = UnitZ(Factor=length)
extr = Extrude(Base=srf, Direction=Z)
jagged = SettingsSpeed()
mesh = MeshBrep(Brep=extr, Settings=jagged)
weld = WeldMesh(Mesh=mesh, Angle=3.141592654)
subdmesh = SubDFromMesh(Mesh=weld, Creases=1, Corners=1, Interpolate=False)
meshsubd = MeshFromSubD(SubD=subdmesh, Density=2)
demesh = DeconstructMesh(Mesh=meshsubd)  # -> Vertices, Faces, Colours, Normals
context_print = ContextPrint(MeshB64=meshsubd)
preview = CustomPreview(Geometry=meshsubd, Material=ColourSwatch(SwatchColor=RGB(255, 255, 255)))
