# Grasshopper definition CUBE TEST FOR WEB.gh (Grasshopper 1.0.8)

length = Slider(1500, range=0..10000)
breath = Slider(1500, range=0..10000)
breath_2 = Slider(1500, range=0..10000)
length_2 = GetNumber(length, AtLeast=1, AtMost=1, Maximum=1.797693135e+308, Minimum=-1.797693135e+308, TreeAccess=False)
breath_3 = GetNumber(breath, AtLeast=1, AtMost=1, Maximum=1.797693135e+308, Minimum=-1.797693135e+308, TreeAccess=False)
extrude = GetNumber(breath_2, AtLeast=1, AtMost=1, Maximum=1.797693135e+308, Minimum=-1.797693135e+308, TreeAccess=False)
xy = XYPlane(Origin=Point(0, 0, 0))
rectangle = Rectangle(Plane=xy, XSize=length_2, YSize=breath_3, Radius=0)  # -> Rectangle, Length
srf = Surface(rectangle.Rectangle)
Z = UnitZ(Factor=extrude)
extr = Extrude(Base=srf, Direction=Z)
mesh = Mesh(extr)
col = Colour(RGB(222, 29, 29))
mcol = MeshColours(Mesh=mesh, Colours=col)
context_bake = ContextBake(Content=mcol)
