# Grasshopper definition Origami_example.gh (Grasshopper 0.8.66)

mesh = Mesh(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)
# This script triangulates the mesh, then extracts the ends of each internal mesh edge and the tips of the 2 connected triangles. These are the 4 points needed to define the hinge force for that edge.
c_script = CSharpScript(M=mesh)  # -> out, A, B, C, D; inputs M: Mesh
# ---------- c_script: C# ----------
    //your code here…

    if (M != null)
    {
      List < Point3d > EdgeEnd1 = new List<Point3d>();
      List < Point3d > EdgeEnd2 = new List<Point3d>();
      List < Point3d > Tip1 = new List<Point3d>();
      List < Point3d > Tip2 = new List<Point3d>();
      M.Faces.ConvertQuadsToTriangles();
      Point3d[] VertexPts = M.Vertices.ToPoint3dArray();

      for (int i = 0; i < M.TopologyEdges.Count; i++)
      {
        int[] ConnectedFaces = M.TopologyEdges.GetConnectedFaces(i);

        if (ConnectedFaces.Length == 2)
        {
          EdgeEnd1.Add(M.TopologyEdges.EdgeLine(i).From);
          EdgeEnd2.Add(M.TopologyEdges.EdgeLine(i).To);

          int[] adjacentface1points = M.TopologyVertices.IndicesFromFace(ConnectedFaces[0]);
          int[] adjacentface2points = M.TopologyVertices.IndicesFromFace(ConnectedFaces[1]);
          IndexPair EndTopologyVertices = M.TopologyEdges.GetTopologyVertices(i);

          int[] connectedTopVerts = M.TopologyVertices.ConnectedTopologyVertices(EndTopologyVertices.I, true);

          for (int j = 0; j < connectedTopVerts.Length; j++)
          {
            if (connectedTopVerts[j] == EndTopologyVertices.J)
            {
              int Tip1TopologyVertex = connectedTopVerts[(j - 1 + connectedTopVerts.Length) % (connectedTopVerts.Length )];
              int Tip2TopologyVertex = connectedTopVerts[(j + 1 + connectedTopVerts.Length) % (connectedTopVerts.Length )];
              int[] Tip1VertexIndex = M.TopologyVertices.MeshVertexIndices(Tip1TopologyVertex);
              int[] Tip2VertexIndex = M.TopologyVertices.MeshVertexIndices(Tip2TopologyVertex);
              Tip1.Add(VertexPts[Tip1VertexIndex[0]]);
              Tip2.Add(VertexPts[Tip2VertexIndex[0]]);
            }
          }

        }
      }
      A = EdgeEnd1;
      B = EdgeEnd2;
      C = Tip1;
      D = Tip2;
    }
# ---------- end c_script ----------

# ---- group: simulation control
# This slider changes the angle each fold tries to reach (positive for mountain folds and negative for valleys). Increase it from zero to see the folding action.
slider = Slider(0, range=0..3.14)
toggle = BooleanToggle(True)
timer = Timer(TimerInterval=20, Target=kangaroo)

# ----
valley = Curve([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])
mountain = Curve([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])
ln = Line(PointA=c_script.C, PointB=c_script.D)
eval = EvaluateCurve(Curve=reparameterize(mountain), Parameter=0.5)  # -> Point, Tangent, Length
eval_2 = EvaluateCurve(Curve=reparameterize(ln), Parameter=0.5)  # -> Point, Tangent, Length
eval_3 = EvaluateCurve(Curve=reparameterize(valley), Parameter=0.5)  # -> Point, Tangent, Length
cp = ClosestPoint(Point=eval_2.Point, Set=eval.Point)  # -> ClosestPoint, CPIndex, Distance
# This part assigns mesh edges to be either mountain or valley folds depending on which of the input sets of curves (red or blue) they are closest to.
cp_2 = ClosestPoint(Point=eval_2.Point, Set=eval_3.Point)  # -> ClosestPoint, CPIndex, Distance
larger = LargerThan(FirstNumber=cp_2.Distance, SecondNumber=cp.Distance)  # -> LargerThan, OrEqualTo
multiplication = Multiplication(A=slider, B=-1)
item = ListItem(List=[slider, multiplication], Index=larger.LargerThan, Wrap=False)

panel = Panel("Preserving edge lengths")
wbedges = MeshEdges(Mesh=mesh)
hinge = Hinge(
    Point1=c_script.A,
    Point2=c_script.B,
    Point3=c_script.C,
    Point4=c_script.D,
    Strength=Slider(1, range=0..1),
    RestAngle=flatten(item))

wbfacepolys = FacePolylines(Mesh=mesh)
explode = Explode(Curve=wbfacepolys, Recursive=True)  # -> Segments, Vertices
lng = ListLength(List=explode.Vertices)
# This part keeps any quads planar, and prevents them shearing.
flip = FlipMatrix(Data=explode.Vertices)
larger_2 = LargerThan(FirstNumber=lng, SecondNumber=4)  # -> LargerThan, OrEqualTo
cull = CullPattern(List=flip, CullPattern=flatten(larger_2.LargerThan))

bang = ExplodeTree(Tree=cull)  # -> _0000, _0010, _0020, _0030, _0040

ln_2 = Line(PointA=bang._0000, PointB=bang._0020)
ln_3 = Line(PointA=bang._0010, PointB=bang._0030)
planarize = Planarize(Point1=bang._0000, Point2=bang._0010, Point3=bang._0020, Point4=bang._0030, PlanarizeStrength=1000)

crv = Curve(flatten([ln_2, ln_3, wbedges]))
springs = SpringsFromLine(Connection=crv, Stiffness=1000, Damping=10, RestLength=crv, Cutoff=0, CompressionFail=0, TensileFail=0, Plasticity=0)
kangaroo = KangarooPhysics(ForceObjects=flatten([springs, hinge, planarize]), Settings=null, Geometry=mesh, SimulationReset=toggle)  # -> Out, Iterations, ParticlesOut, GeometryOut
c_script_2 = CSharpScript(M=kangaroo.GeometryOut)  # -> out, A; inputs M: Mesh
# ---------- c_script_2: C# ----------
    M.Unweld(0, true);
    A = M;
# ---------- end c_script_2 ----------
preview = CustomPreview(
    Geometry=c_script_2.A,
    Shader={diffuse=RGB(105, 105, 105), ambient=RGB(128, 128, 128), emission=RGB(211, 211, 211), specular=RGB(255, 255, 255), shine=0.5, transparency=0})
