# Grasshopper definition gh_pillar 59_project_rhino compute potential test script.gh (Grasshopper 1.0.8)

# ----
# Boundary parameters
boundary_y_length = Slider(25000, range=0..100000)
boundary_x_length = Slider(25000, range=0..100000)

length_x = GetNumber(boundary_x_length, AtLeast=1, AtMost=1, Maximum=1.797693135e+308, Minimum=-1.797693135e+308, TreeAccess=False)
length_y = GetNumber(boundary_y_length, AtLeast=1, AtMost=1, Maximum=1.797693135e+308, Minimum=-1.797693135e+308, TreeAccess=False)

x_length = Data(length_x)
y_length = Data(length_y)

# ----
# Step:1
# Creating planar surface
xy = XYPlane(Origin=Point(0, 0, 0))
x_length_2 = Data(x_length)
y_length_2 = Data(y_length)
rectangle = Rectangle(Plane=xy, XSize=x_length_2, YSize=y_length_2, Radius=0)  # -> Rectangle, Length
srf = Surface(rectangle.Rectangle)
boundary_curve = Data(rectangle.Rectangle)
# Step:2
# creating the curved surface
base_surface = Data(srf)

base_surface_2 = Data(base_surface)
swatch = ColourSwatch(SwatchColor=RGB(168, 213, 255))
preview = CustomPreview(Geometry=base_surface_2, Material=swatch)

smooth = SettingsQuality()
mesh = MeshBrep(Brep=base_surface_2, Settings=smooth)
mcol = MeshColours(Mesh=mesh, Colours=swatch)
context_bake = ContextBake(Geometry1=mcol)

number_of_division_in_x_and_y = GetNumber(Slider(2, range=0..10), AtLeast=1, AtMost=1, Maximum=1.797693135e+308, Minimum=-1.797693135e+308, TreeAccess=False)
min_z_value = GetNumber(
    Slider(9306, range=0..100000),
    AtLeast=1,
    AtMost=1,
    Maximum=1.797693135e+308,
    Minimum=-1.797693135e+308,
    TreeAccess=False)
max_z_value = GetNumber(
    Slider(17067, range=0..100000),
    AtLeast=1,
    AtMost=1,
    Maximum=1.797693135e+308,
    Minimum=-1.797693135e+308,
    TreeAccess=False)

surface_division = Data(number_of_division_in_x_and_y)
max_z_value_2 = Data(max_z_value)
min_z_value_2 = Data(min_z_value)

base_surface_3 = Data(base_surface)
data = Data(surface_division)
data_2 = Data(surface_division)
sdivide = DivideSurface(Surface=base_surface_3, UCount=data, VCount=data_2)  # -> flatten(Points), Normals, Parameters
surface_points = Data(sdivide.Points)

max_z_value_3 = Data(max_z_value_2)
min_z_value_3 = Data(min_z_value_2)
dom = ConstructDomain(DomainStart=min_z_value_3, DomainEnd=max_z_value_3)
surface_points_2 = Data(surface_points)
lng = ListLength(List=surface_points_2)
random = Random(Range=dom, Number=lng, Seed=Slider(21, range=0..100))
surface_points_3 = Data(surface_points)
Z = UnitZ(Factor=random)
data_3 = Data(surface_division)
move = Move(Geometry=surface_points_3, Motion=Z)  # -> Geometry, Transform
addition = Addition(A=data_3, B="1")
srfgrid = SurfaceFromPoints(Points=move.Geometry, UCount=addition, Interpolate=False)
wavy_surface = Data(srfgrid)

base_surface_4 = Data(base_surface)
data_4 = Data(surface_division)
data_5 = Data(surface_division)
divide = DivideDomain²(Domain=base_surface_4, UCount=data_4, VCount=data_5)
subsrf = Isotrim(Surface=base_surface_4, Domain=divide)
splited_surface = Data(subsrf)

wavy_surface_2 = Data(wavy_surface)
swatch_2 = ColourSwatch(SwatchColor=RGB(66, 92, 14))
preview_2 = CustomPreview(Geometry=wavy_surface_2, Material=swatch_2)

# ----
# Step:3
# Generating voronoi pattern
splited_surface_2 = Data(splited_surface)
area = Area(Geometry=splited_surface_2)  # -> Area, Centroid
center_point_of_the_cell = Data(area.Centroid)

center_point_of_the_cell_2 = Data(center_point_of_the_cell)
lng_2 = ListLength(List=center_point_of_the_cell_2)
dom_2 = ConstructDomain(DomainStart=Slider(0, range=0..100), DomainEnd=Slider(1909, range=0..10000))
dom_3 = ConstructDomain(DomainStart=Slider(0, range=0..100), DomainEnd=Slider(6032, range=0..10000))
pdecon = Deconstruct(Point=center_point_of_the_cell_2)  # -> XComponent, YComponent, ZComponent
random_2 = Random(Range=dom_2, Number=lng_2, Seed=Slider(49, range=0..100))
random_3 = Random(Range=dom_3, Number=lng_2, Seed=Slider(42, range=0..100))
round = Round(Number=random_2)  # -> Nearest, Floor, Ceiling
round_2 = Round(Number=random_3)  # -> Nearest, Floor, Ceiling
addition_2 = Addition(A=pdecon.XComponent, B=round.Ceiling)
addition_3 = Addition(A=pdecon.YComponent, B=round_2.Ceiling)
pt = ConstructPoint(XCoordinate=addition_2, YCoordinate=addition_3, ZCoordinate=pdecon.ZComponent)
moved_points_in_x_and_y_dir = Data(pt)

moved_points_in_x_and_y_dir_2 = Data(moved_points_in_x_and_y_dir)
boundary_curve_2 = Data(boundary_curve)
voronoi = Voronoi(Points=moved_points_in_x_and_y_dir_2, Boundary=boundary_curve_2, BruteForceOverride=False)
voronoi_cell_2d = Data(voronoi)

# ----
# Step:4
# Creating pillars
number_slider = Slider(0.91, range=0..1)
voronoi_cell_2d_2 = Data(voronoi_cell_2d)
wavy_surface_3 = Data(wavy_surface)
project = Project(Curve=voronoi_cell_2d_2, Brep=wavy_surface_3, Direction=Vector(0, 0, 1))
area_2 = Area(Geometry=voronoi_cell_2d_2)  # -> Area, Centroid
projected_voronoi_curve = Data(project)
cell_center = Data(area_2.Centroid)
cell_center_2 = Data(cell_center)
scale = Scale(Geometry=voronoi_cell_2d_2, Center=cell_center_2, Factor=number_slider)  # -> Geometry, Transform
scaled_planar_voronoi_cell = Data(scale.Geometry)

cell_center_3 = Data(cell_center)
cir = Circle(Plane=cell_center_3, Radius=Slider(1500, range=0..10000))
pier_circle = Data(cir)

Z_2 = UnitZ(Factor=Slider(1849, range=0..10000))
pier_circle_2 = Data(pier_circle)
neg = Negative(Value=Z_2)
move_2 = Move(Geometry=pier_circle_2, Motion=neg)  # -> Geometry, Transform
pier_circle_2_2 = Data(move_2.Geometry)

projected_voronoi_curve_2 = Data(projected_voronoi_curve)
number_slider_2 = Slider(0.5, range=0..1)
bbox = BoundingBox(Content=projected_voronoi_curve_2, Plane=PlaneXY(0, 0, 0))  # -> Box, Box_2
box = EvaluateBox(Box=bbox.Box_2, UParameter=number_slider_2, VParameter=number_slider_2, WParameter=Slider(0, range=0..1))  # -> Plane, Point, Include
cell_center_4 = Data(graft(cell_center))
ln = Line(StartPoint=box.Point, EndPoint=cell_center_4)
len = Length(Curve=ln)
subtraction = Subtraction(A=len, B=Slider(2973, range=0..10000))
move_values = Data(simplify(subtraction))

Z_3 = UnitZ(Factor=Slider(10000, range=0..10000))
pier_circle_2_3 = Data(pier_circle_2_2)
neg_2 = Negative(Value=Z_3)
extr = Extrude(Base=pier_circle_2_3, Direction=neg_2)
data_6 = Data(extr)

scaled_planar_voronoi_cell_2 = Data(simplify(graft(scaled_planar_voronoi_cell)))
move_values_2 = Data(move_values)
Z_4 = UnitZ(Factor=move_values_2)
projected_voronoi_curve_3 = Data(projected_voronoi_curve)
pier_circle_2_4 = Data(simplify(graft(pier_circle_2_2)))
pier_circle_3 = Data(simplify(graft(pier_circle)))
move_3 = Move(Geometry=scaled_planar_voronoi_cell_2, Motion=Z_4)  # -> Geometry, Transform
merge = Merge(
    Data1=simplify(projected_voronoi_curve_3),
    Data2=simplify(move_3.Geometry),
    Data3=simplify(pier_circle_3),
    Data4=pier_circle_2_4)
loft = Loft(Curves=merge, Options={Adjust=True, Closed=False, LoftEnds=0, LoftSimp=0, LoftType=0, Rebuild=10, Refit=0.01})
final_piers = Data(loft)

data_7 = Data(simplify(graft(data_6)))
final_piers_2 = Data(final_piers)
swatch_3 = ColourSwatch(SwatchColor=RGB(145, 145, 145))
join = BrepJoin(Breps=[data_7, final_piers_2])  # -> Breps, Closed
preview_3 = CustomPreview(Geometry=join.Breps, Material=swatch_3)

smooth_2 = SettingsQuality()
mesh_2 = MeshBrep(Brep=wavy_surface_2, Settings=smooth_2)
mcol_2 = MeshColours(Mesh=mesh_2, Colours=swatch_2)
context_bake_2 = ContextBake(Geometry2=mcol_2)

smooth_3 = SettingsQuality()
mesh_3 = MeshBrep(Brep=join.Breps, Settings=smooth_3)
mcol_3 = MeshColours(Mesh=mesh_3, Colours=swatch_3)
context_bake_3 = ContextBake(Geometry3=mcol_3)
