# Grasshopper definition rnd_lattice.gh (Grasshopper 1.0.8)
# plug-ins: Kangaroo2 Components
# Uses the multipipe component to create a mesh lattice.

boxsize = GetNumber(
    Slider(10, range=0.5..10),
    AtLeast=1,
    AtMost=2147483647,
    Maximum=1.797693135e+308,
    Minimum=-1.797693135e+308,
    TreeAccess=False)
nodesize = GetNumber(
    Slider(7, range=3..10),
    AtLeast=1,
    AtMost=2147483647,
    Maximum=1.797693135e+308,
    Minimum=-1.797693135e+308,
    TreeAccess=False)
count = GetNumber(
    Slider(42, range=10..100),
    AtLeast=1,
    AtMost=2147483647,
    Maximum=1.797693135e+308,
    Minimum=-1.797693135e+308,
    TreeAccess=False)
box = CenterBox(Base=PlaneXY(0, 0, 0), X=boxsize, Y=boxsize, Z=boxsize)
division = Division(A=nodesize, B="10")
pop3d = Populate3D(Region=box, Count=count, Seed=1)
prox = Proximity3D(Points=pop3d, Group=5)  # -> flatten(Links), Topology
dupln = RemoveDuplicateLines(Lines=prox.Links, Tolerance=0.01)
mp = MultiPipe(Curves=dupln, NodeSize=division, EndOffset=1, StrutSize=1, Segment=0, KinkAngle=0.6, CubeFit=0)
meshsubd = MeshFromSubD(SubD=mp, Density=2)
weld = WeldMesh(Mesh=meshsubd, Angle=3.141592654)

# ---- group: Cheap Occlusion
demesh = DeconstructMesh(Mesh=weld)  # -> Vertices, Faces, Colours, Normals
amp = Amplitude(Vector=demesh.Normals, Amplitude="0.1")
addition = Addition(A=demesh.Vertices, B=amp)
meshray = MeshRay(Mesh=weld, Point=addition, Direction=amp)  # -> Point, Hit
gradient = Gradient(
    LowerLimit=0,
    UpperLimit=1,
    Parameter=meshray.Hit,
    stops=[0: RGB(0, 98, 0), 0.25: RGB(81, 175, 17), 0.5: RGB(159, 198, 146), 0.75: RGB(170, 235, 41), 1: RGB(221, 255, 53)])
mcol = MeshColours(Mesh=weld, Colours=gradient)
mblur = BlurMesh(Mesh=mcol, Iterations=Slider(5, range=0..5))

# ----
mesh = Mesh(mblur)
context_bake = ContextBake(Content=mesh)
M = MeshToBase64Draco()  # -> base64Draco; inputs mesh: Mesh
# ---------- M: C# ----------
    var options = new Rhino.FileIO.DracoCompressionOptions();
    options.CompressionLevel = 5;
    options.IncludeTextureCoordinates = false;
    options.IncludeVertexColors = false;

    var compressed = Rhino.FileIO.DracoCompression.Compress(mesh, options);
    base64Draco = compressed.ToBase64String();
# ---------- end M ----------

# ---- group: RH_OUT:meshb64
txt = Text(M)
