# Grasshopper definition simpleboxtest.gh (Grasshopper 1.0.7)

height = GetNumber(
    Slider(531, range=100..1000),
    AtLeast=1,
    AtMost=2147483647,
    Maximum=1.797693135e+308,
    Minimum=-1.797693135e+308,
    TreeAccess=False)
width = GetNumber(
    Slider(1645, range=800..2000),
    AtLeast=1,
    AtMost=2147483647,
    Maximum=1.797693135e+308,
    Minimum=-1.797693135e+308,
    TreeAccess=False)
num = Number(height)
num_2 = Number(width)
pt = ConstructPoint(XCoordinate=num, YCoordinate=num, ZCoordinate=num_2)
pt_2 = ConstructPoint(XCoordinate=0, YCoordinate=0, ZCoordinate=0)
box = Box2Pt(PointA=pt_2, PointB=pt, Plane=PlaneXY(0, 0, 0))
mesh = MeshBrep(
    Brep=box,
    Settings={GridMaxCount=0, GridMinCount=16, JaggedSeams=False, MaxEdgeLength=0, MinEdgeLength=0.0001, MinTolerance=0, Refine=True, RefineAngle=0, RelativeTolerance=0.65, SimplePlanes=True, Tolerance=0})
context_bake = ContextBake(Geometry=mesh)
