# Grasshopper definition test.gh (Grasshopper 1.0.7)
# plug-ins: ShapeDiverForGrasshopper, Human

sddp = ShapeDiverDocumentPayload({AbsoluteTolerance=0, AngleTolerance=0, DistanceDisplayPrecision=0, GltfVersion="Gltf2", GrasshopperVersion="1.0.0007", InputGroups="{}", OutputGroups="{}", RelativeTolerance=0, RhinoVersion="7.34.23267.11001", UnitSystem=0, VersionCreated="1.15.0.0", VersionSaved="1.15.0.0"})
xy = XYPlane(Origin=Point(0, 0, 0))
rectangle_size = GetNumber(Slider(1500, range=0..10000), AtLeast=1, AtMost=1, Maximum=1.797693135e+308, Minimum=-1.797693135e+308, TreeAccess=False)
rectangle = Rectangle(Plane=xy, XSize=rectangle_size, YSize=rectangle_size, Radius=0)  # -> Rectangle, Length
height = GetNumber(Slider(1500, range=0..10000), AtLeast=1, AtMost=1, Maximum=1.797693135e+308, Minimum=-1.797693135e+308, TreeAccess=False)
srf = Surface(rectangle.Rectangle)
offset = OffsetCurve(Curve=rectangle.Rectangle, Distance=Slider(1500, range=0..10000), Corners=1)
Z = UnitZ(Factor=height)
extr = Extrude(Base=srf, Direction=Z)
srf_2 = Surface(offset)
line_weight = GetNumber(Slider(20, range=0..10000), AtLeast=1, AtMost=1, Maximum=1.797693135e+308, Minimum=-1.797693135e+308, TreeAccess=False)
wires = BrepWireframe(Brep=extr, Density=-1)
list = ValueList({"One": 0, "Two": 1, "Three": 2}, selected="Three")
preview = CustomPreview(Geometry=extr, Material=ColourSwatch(SwatchColor=RGB(46, 255, 171)))
previewlw = CustomPreviewLineweights(
    Geometry=wires,
    Shader={diffuse=RGB(255, 105, 180), emission=RGB(76, 32, 54), shine=0.5, specular=RGB(255, 255, 255), transparency=0},
    Thickness=line_weight,
    Absolute=False)
get_string = GetString(list, AtLeast=1, AtMost=1, TreeAccess=False)
filter = StreamFilter(
    Gate=get_string,
    Stream0=ColourSwatch(SwatchColor=RGB(255, 0, 0)),
    Stream1=ColourSwatch(SwatchColor=RGB(61, 61, 61)),
    Stream2=ColourSwatch(SwatchColor=RGB(191, 180, 180)))
preview_2 = CustomPreview(Geometry=srf_2, Material=filter)
